# Dynamo graph scriptMetricsv2.dyn (Dynamo 2.0.2.6826)

# group: metrics
boolean = BoolSelector(true)
project = Python(IN[0]=boolean)
# ---------- project.python (18 lines) ----------
import clr
clr.AddReference("RevitServices")
import RevitServices
from RevitServices.Persistence import DocumentManager


doc = DocumentManager.Instance.CurrentDBDocument

elementlist = list()
projinfo = doc.ProjectInformation

try:
	elementlist.append(projinfo.Author)
except:
	elementlist.append(None)
elementlist.append(projinfo.Name)
elementlist.append(projinfo.Number)
OUT = elementlist
# ----------------------------------------
code_block = CodeBlock(seq=project) { seq[0]; seq[1]; seq[2]; }
name = CodeBlock(Name=code_block.out1) { Name; }
number = CodeBlock(Number=code_block.out2) { Number; }
script = Python()  # unwired: IN[0]
# ---------- script.python (13 lines) ----------
# Enable Python support and load DesignScript library
import clr
clr.AddReference('DynamoRevitDS')
import Dynamo 
import sys
sys.path.append(r'C:\Program Files (x86)\IronPython 2.7\Lib')
import os
DynamoRevit=Dynamo.Applications.DynamoRevit()
scriptname=DynamoRevit.RevitDynamoModel.CurrentWorkspace.FileName

name=os.path.basename(scriptname)
filename,extention=os.path.splitext(name)
OUT=filename
# ----------------------------------------
log_file = Python(IN[0]=name, IN[1]=number, IN[2]=script)
# ---------- log_file.python (39 lines) ----------
# Original Script by EwanO 2018 (Sastrugi Package) 
# Modified and added to by Paul Fassnidge 2019
# This code creates a blank text file in a specified location that
# contains script data in txt file name.

import clr
import System
from System.IO import Directory

import sys
# load python
pyt_path = r'C:\Program Files (x86)\IronPython 2.7\Lib'
sys.path.append(pyt_path)

from datetime import datetime

project = IN[0]
number = IN[1]
scriptname = IN[2]

# get the current date and time
datestamp = datetime.today().strftime("%Y-%m-%d")
timestamp = datetime.now().strftime("%H-%M-%S")

import os

## set the output directory and gather log data
dir = 'ENTER YOUR DIRECTORY LOCATION'
   
# create a directory for each user of a machine
Directory.CreateDirectory(dir)

# generate the file name for the log file
filename = (str(datestamp) + '_' + str(timestamp) + '_' +str(project) + '_' +str(number) + '_' +str(scriptname) + '.txt')

# create the log file (blank text file)
logger = open(dir + '\\' + filename,'w+')

OUT = str("Run Logged")
# ----------------------------------------
