# Dynamo graph scriptMetricsv8.dyn (Dynamo 2.0.3.8810)

code_block = CodeBlock { true; }

# group: Analytics
log_start_time = Python()  # unwired: IN[0]
# ---------- log_start_time.python (21 lines) ----------
#BPE data metrics by PF

import clr
import System
from System.IO import Directory

import sys
# load python
pyt_path = r'C:\Program Files (x86)\IronPython 2.7\Lib'
sys.path.append(pyt_path)

from datetime import datetime

project = IN[0]

# get the current date and time
starttime = datetime.now().strftime("%H-%M-%S")

import os

OUT = starttime
# ----------------------------------------
control = CodeBlock(passthrough=code_block, waitfor=log_start_time) { [passthrough,waitfor][0]; }
python_script = Python(IN[0]=control, IN[1]=log_start_time)
# ---------- python_script.python (66 lines) ----------
#HDT data analytics by PF

import clr
import sys

clr.AddReference("RevitServices")
clr.AddReference('DynamoRevitDS')
import RevitServices
from RevitServices.Persistence import DocumentManager

pyt_path = r'C:\Program Files (x86)\IronPython 2.7\Lib'
sys.path.append(pyt_path)

import clr
import System
import sys
import Dynamo 
import os

from System.IO import Directory
from System import Environment

DynamoRevit=Dynamo.Applications.DynamoRevit()

from datetime import datetime

#Get doc and dynamo stuff
doc = DocumentManager.Instance.CurrentDBDocument
app = DocumentManager.Instance.CurrentUIApplication.Application
scriptname=DynamoRevit.RevitDynamoModel.CurrentWorkspace.FileName

name=os.path.basename(scriptname)
filename,extention=os.path.splitext(name)
projinfo = doc.ProjectInformation

passthrough = IN[0]
starttime = IN[1]

project = projinfo.Name
number = projinfo.Number
scriptname = filename

starttime = IN[1]
user = Environment.UserName;

# get the current date and time
datestamp = datetime.today().strftime("%Y-%m-%d")
endtime = datetime.now().strftime("%H-%M-%S")

dir = r'C:\Users\{}\Hydrock Consultants Ltd\BIM - Documents\03 Hydrock BIM Standards and Templates\07 Automation\Analytics'.format(user)
dirQ = r'Q:\Office\IT Software\Dynamo\data'

# create a directory
Directory.CreateDirectory(dir)
Directory.CreateDirectory(dirQ)

# generate the file name
filename = (str(datestamp) + '_' +str(endtime) + '_' +str(project) + '_' +str(number) + '_' +str(scriptname) + '_' +str(starttime) + '_' +str(user) + '_' + '.txt')

filenameQ = (str(datestamp) + '_' +str(endtime) + '_' +str(project) + '_' +str(number) + '_' +str(scriptname) + '_' +str(starttime) + '_' +str(user) + '_' + '.txt')

# create the log file
logger = open(dir + '\\' + filename,'w+')
loggerQ = open(dirQ + '\\' + filenameQ,'w+')

OUT = str("Dynamo Analytics Complete")
# ----------------------------------------
